% Simulink design studies Case_1.mldatx for model Case_1

study "DesignStudy": 4141 simulations
  combinatorial set (4141 points):
    "Block Parameter_1": BlockParameter(BlockPath=Case_1/RPM, Name=Value), values 300:400 (101 points)
    "Block Parameter_2": BlockParameter(BlockPath=Case_1/External force (N), Name=Value), values 60:100 (41 points)