% Simulink design studies Case_2.mldatx for model Case_2

study "DesignStudy": 4141 simulations
  combinatorial set (4141 points):
    "Block Parameter_1": BlockParameter(BlockPath=Case_2/RPM, Name=Value), values 300:400 (101 points)
    "Block Parameter_2": BlockParameter(BlockPath=Case_2/External force (N), Name=Value), values 60:100 (41 points)