% Simulink design studies Case_3.mldatx for model Case_3

study "DesignStudy": 4961 simulations
  combinatorial set (4961 points):
    "Block Parameter_1": BlockParameter(BlockPath=Case_3/RPM_Initial, Name=Value), values 300:10:400 (11 points)
    "Block Parameter_2": BlockParameter(BlockPath=Case_3/RPM_Final, Name=Value), values 500:10:600 (11 points)
    "Block Parameter_3": BlockParameter(BlockPath=Case_3/External force (N), Name=Value), values 60:100 (41 points)